# Grasshopper definition 三大机器人品牌6轴法兰方向可视化.gh (Grasshopper 1.0.7)
# plug-ins: Robim, GHPractice

load_robot = LoadRobotSystem(
    RobotName="FANUC.R_2000ic210F",
    hascoupledplaneeuler=False,
    hasplantformeuler=False,
    hasroboteuler=False,
    hastrackeuler=False,
    trackHangUpSideDown="No")
load_robot_2 = LoadRobotSystem(
    RobotName="ABB.IRB6700_320_150",
    hascoupledplaneeuler=False,
    hasplantformeuler=False,
    hasroboteuler=False,
    hastrackeuler=False,
    trackHangUpSideDown="No")
load_robot_3 = LoadRobotSystem(
    RobotName="KUKA.KR210_R2700_ultra",
    hascoupledplaneeuler=False,
    hasplantformeuler=False,
    hasroboteuler=False,
    hastrackeuler=False,
    trackHangUpSideDown="No")
panel = Panel("""0
0
0
0
0
0""")
panel_2 = Panel("""0
0
0
0
0
0""")
panel_3 = Panel("""0
-90
90
0
0
0""")
degtorad = DegreesToRadians(Degrees=panel, RobotSystem=load_robot_2, MechanicalGroup=0)
degtorad_2 = DegreesToRadians(Degrees=panel_2, RobotSystem=load_robot, MechanicalGroup=0)
degtorad_3 = DegreesToRadians(Degrees=panel_3, RobotSystem=load_robot_3, MechanicalGroup=0)
target = CreateTarget(Joints=degtorad, IsCartesian=False)
target_2 = CreateTarget(Joints=degtorad_2, IsCartesian=False)
target_3 = CreateTarget(Joints=degtorad_3, IsCartesian=False)
program = CreateProgram(Name="DefaultProgram", RobotSystem=load_robot_2, Targets1=target, StepSize=10, UseIkfast=False, Compute=Toggle(True))  # -> Program, Code, Duration, Warnings, Errors, Progress
program_2 = CreateProgram(Name="DefaultProgram", RobotSystem=load_robot, Targets1=target_2, StepSize=10, UseIkfast=False, Compute=Toggle(True))  # -> Program, Code, Duration, Warnings, Errors, Progress
program_3 = CreateProgram(Name="DefaultProgram", RobotSystem=load_robot_3, Targets1=target_3, StepSize=10, UseIkfast=False, Compute=Toggle(True))  # -> Program, Code, Duration, Warnings, Errors, Progress
series = Series(Start=0, Step="1500", Count="3")
sim = ProgramSimulation(Program=program.Program, Time="1", Normalized=True)  # -> SystemMeshes, JointRotations, Plane, Index, Time, Program, Errors, TargetPlane, WorkpieceMesh, CoupledPlane
sim_2 = ProgramSimulation(Program=program_2.Program, Time="1", Normalized=True)  # -> SystemMeshes, JointRotations, Plane, Index, Time, Program, Errors, TargetPlane, WorkpieceMesh, CoupledPlane
sim_3 = ProgramSimulation(Program=program_3.Program, Time="1", Normalized=True)  # -> SystemMeshes, JointRotations, Plane, Index, Time, Program, Errors, TargetPlane, WorkpieceMesh, CoupledPlane
X = UnitX(Factor=series)
Y = UnitY(Factor=series)
group = Group(Objects=sim_2.SystemMeshes)
group_2 = Group(Objects=sim_3.SystemMeshes)
group_3 = Group(Objects=sim.SystemMeshes)
merge = Merge(Data1=group_3, Data2=group, Data3=group_2)
item = ListItem(List=sim_2.Plane, Index=0, Wrap=True)  # -> Item1, Item
item_2 = ListItem(List=sim_3.Plane, Index=0, Wrap=True)  # -> Item1, Item
item_3 = ListItem(List=sim.Plane, Index=0, Wrap=True)  # -> Item1, Item
move = Move(Geometry=merge, Motion=Y)  # -> Geometry, Transform
ungroup = Ungroup(Group=move.Geometry)

# ---- group: 机器人网格
mesh = Mesh(Tree({0;0;0}: [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], {0;0;1}: [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], {0;0;2}: [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]))

# ---- group: 机器人6轴法兰平面
pln = Plane([Plane(origin=(2112.494564, 0, 2260.006584), x=(3.673205103e-06, 0, -1), y=(0, 1, 0)), Plane(origin=(1806.995225, 1500, 1970.005491), x=(-3.673205103e-06, 2.653589793e-06, 1), y=(-9.747179572e-12, -1, 2.653589793e-06)), Plane(origin=(1764.995926, 3000, 1784.005198), x=(3.673205103e-06, 0, -1), y=(0, 1, 0))])

# ----
move_2 = Move(Geometry=[item_3.Item1, item.Item1, item_2.Item1], Motion=Y)  # -> Geometry, Transform
bang = ExplodeTree(Data=simplify(ungroup))  # -> Branch0, Branch1, Branch2
plane_dis = PlaneDisplay(Plane=move_2.Geometry, Amplitude="600", Width=5)
preview = CustomPreview(Geometry=bang.Branch0, Material=ColourSwatch(SwatchColor=RGB(222, 222, 222)))
preview_2 = CustomPreview(Geometry=bang.Branch1, Material=ColourSwatch(SwatchColor=RGB(202, 200, 0)))
preview_3 = CustomPreview(Geometry=bang.Branch2, Material=ColourSwatch(SwatchColor=RGB(224, 111, 54)))
